# Grasshopper definition postgres_port.gh (Grasshopper 1.0.7)
# plug-ins: MouseSelection, RemoSharp

panel = Panel("C:\Users\akhaj\source\repos\CollaborativeGeometryServer\local_db\local_db.json")
button = Button()
xy = XYPlane(Origin=Point(0, 0, 0))
file = ReadFile(File=panel, PerLineParse=False)
rtf = ReadTreeFile(Json=file, ResetPlane=xy, ResetZShift=0, RESET=button)  # -> BonsaiTree, Json, Breps, Colors
writetofile = WriteToFile(Write=button, TxtContent=rtf.Json, FilePath=panel)
serializetb = SerializeTBranch(TBranches=rtf.BonsaiTree)
